# Grasshopper definition Camera Aperture Script.gh (Grasshopper 1.0.7)
# plug-ins: Bifocals

# ---- group: Starting Circles
slider = Slider(1.379, range=0..2)
xy = XYPlane(Origin=Point(0, 0, 0))
slider_2 = Slider(10, range=0..20)
cir = Circle(Plane=xy, Radius=Slider(0.798, range=0..1))
cir_2 = Circle(Plane=xy, Radius=slider)

# ---- group: Cylinder Create
slider_3 = Slider(0.058, range=0..1)
cyl = Cylinder(Base=PlaneXY(0, 0, 0), Radius=Slider(0.608, range=0..1), Length=slider_3)
cyl_2 = Cylinder(Base=PlaneXY(0, 0, 0), Radius=slider, Length=slider_3)
cap = CapHoles(Brep=cyl_2)
cap_2 = CapHoles(Brep=cyl)
sdiff = SolidDifference(FirstSet=cap, SecondSet=cap_2)

# ---- group: Area + Endpoints
offset = Offset(Curve=cir, Distance=Slider(-0.172, range=-1..1.001), Plane=PlaneXY(0, 0, 0), Corners=1)
divide = DivideCurve(Curve=cir_2, Number=slider_2, Kinks=False)  # -> Points, Tangents, Parameters
divide_2 = DivideCurve(Curve=cir_2, Number=slider_2, Kinks=False)  # -> Points, Tangents, Parameters
area = Area(Geometry=offset)  # -> Area, Centroid

# ---- group: Aperture Rotation
slider_4 = Slider(-0.4828, range=-0.8..0)

# ----
slider_5 = Slider(-1, range=-3..3)
slider_6 = Slider(0.437, range=0..1)
division = Division(A=slider_6, B=2)
slider_7 = Slider(0.186, range=0..1)
list_item = ListItem(List=divide.Points, Index=0, Wrap=True)
bool = Boolean(True)
xy_2 = XYPlane(Origin=divide.Points)

# ---- group: Interior + Exterior Lines
ln = Line(PointA=area.Centroid, PointB=divide.Points)

# ----
evaluate_curve = EvaluateCurve(Curve=ln, Parameter=slider_6)  # -> Point, Tangent, Angle
evaluate_curve_2 = EvaluateCurve(Curve=reparameterize(ln), Parameter=division)  # -> Point, Tangent, Angle
shift = ShiftList(List=evaluate_curve_2.Point, Shift=slider_5, Wrap=True)

# ---- group: Center Points and Lines
ln_2 = Line(PointA=divide.Points, PointB=shift)
ccx = CurveCurve(CurveA=cir, CurveB=ln_2)  # -> Points, ParamsA, ParamsB
rotate = Rotate(Geometry=flatten(ccx.Points), Angle=slider_4, Plane=xy)  # -> Geometry, Transform

# ----
vec2pt = Vector2Pt(PointA=divide_2.Points, PointB=flatten(ccx.Points), Unitize=False)  # -> Vector, Length
vec2pt_2 = Vector2Pt(PointA=divide_2.Points, PointB=rotate.Geometry, Unitize=False)  # -> Vector, Length
subtraction = Subtraction(A=vec2pt_2.Length, B=vec2pt.Length)
vdis = VectorDisplay(Anchor=divide.Points, Vector=vec2pt.Vector)
vdis_2 = VectorDisplay(Anchor=divide.Points, Vector=vec2pt_2.Vector)
shift_2 = ShiftList(List=evaluate_curve.Point, Shift=slider_5, Wrap=True)

# ---- group: Interior + Exterior Lines (continued)
ln_3 = Line(PointA=shift_2, PointB=divide.Points)

# ----
abs = Absolute(Input=subtraction)

# ---- group: Loft of Two Lines
graft_tree = GraftTree(Tree=flatten(ln), IncludeEmptyLists=True, IncludeNullItems=True)
graft_tree_2 = GraftTree(Tree=flatten(ln_3), IncludeEmptyLists=True, IncludeNullItems=True)
loft = Loft(
    Section=[graft_tree_2, graft_tree],
    Options={Adjust=False, Closed=False, LoftEnds=0, LoftSimp=0, LoftType=0, Rebuild=10, Refit=0.01})

# ----
larger = LargerThan(FirstNumber=abs, SecondNumber=slider_7)  # -> LargerThan, OrEqualTo
mindex = MemberIndex(Set=larger.LargerThan, Member=bool)  # -> Index, Count
angle = Angle(VectorA=vec2pt_2.Vector, VectorB=vec2pt.Vector)  # -> Angle, Reflex
replace = ListReplace(List=angle.Angle, Item=Slider(0.772, range=0..1), Indices=mindex.Index, Wrap=False)
replace_2 = ListReplace(List=subtraction, Item=slider_7, Indices=mindex.Index, Wrap=False)
amp = Amplitude(Vector=vec2pt.Vector, Amplitude=replace_2)
rotate_2 = Rotate(Geometry=flatten(loft), Angle=angle.Angle, Plane=xy_2)  # -> Geometry, Transform
move = Move(Geometry=rotate_2.Geometry, Translation=amp)  # -> Geometry, Transform
extr = Extrude(Base=rotate_2.Geometry, Direction=Vector(2.819553477e-05, 0, 0.03329819989))
